# Dynamo graph ETABS MODE_CREATE.dyn (Dynamo 2.0.2.6826)

# group: Excel Etabs
file_path = Filename("..\BIM Sticky\20190418_ETABS Export v2.xlsx")  # graph input
fromPath = FileObject(path=file_path)  # "File.FromPath"

# group: Collect data
code_block = CodeBlock()
# ---------- code_block.designscript (2 lines) ----------
//Worksheet 2
"Beam and Brace Connect";
# ----------------------------------------
importExcel = Data.ImportExcel(file=fromPath, sheetName=code_block)
code_block_2 = CodeBlock()
# ---------- code_block_2.designscript (2 lines) ----------
//Worksheet 2
"Joint Coordinates";
# ----------------------------------------
importExcel_2 = Data.ImportExcel(file=fromPath, sheetName=code_block_2)
code_block_3 = CodeBlock()
# ---------- code_block_3.designscript (2 lines) ----------
//Worksheet 2
"Frame Assignment Summary";
# ----------------------------------------
importExcel_3 = Data.ImportExcel(file=fromPath, sheetName=code_block_3)

# group: Python create framing
python_beam_and_brace_connection = Python(IN[0]=importExcel)  # "Python Beam and Brace Connection Object"
# ---------- python_beam_and_brace_connection.python (20 lines) ----------
# Enable Python support and load DesignScript library
import clr
clr.AddReference('ProtoGeometry')
from Autodesk.DesignScript.Geometry import *

class Beam:
	def __init__(self, beam, I_EndJoint, J_EndJoint, CurveType):
		self.beam = beam
		self.I_EndJoint = I_EndJoint
		self.J_EndJoint = J_EndJoint
		self.CurveType = CurveType
		
data = IN[0]
out = []

for d in data[1:]:
	beam = Beam(d[0], d[1], d[2], d[3])
	out.Add(beam)
	
OUT = out
# ----------------------------------------
python_joint_coordinates_object = Python(IN[0]=importExcel_2)
# ---------- python_joint_coordinates_object.python (23 lines) ----------
# Enable Python support and load DesignScript library
import clr
clr.AddReference('ProtoGeometry')
from Autodesk.DesignScript.Geometry import *

class JointCoord:
	def __init__(self, story, label, unique, X, Y, Z, special):
		self.story = story
		self.label = label
		self.unique = unique
		self.X = X
		self.Y = Y
		self.Z = Z
		self.special = special
		
data = IN[0]
out = []

for d in data[2:]:
	jointCoord = JointCoord(d[0], d[1], d[2], d[3], d[4], d[5], d[6])
	out.append(jointCoord)
	
OUT = out
# ----------------------------------------
python_frame_assignment_summary = Python(IN[0]=importExcel_3)  # "Python Frame Assignment Summary Object"
# ---------- python_frame_assignment_summary.python (21 lines) ----------
# Enable Python support and load DesignScript library
import clr
clr.AddReference('ProtoGeometry')
from Autodesk.DesignScript.Geometry import *

class Frame:
	def __init__(self, story, label, unique, DesignType, DesignSection):
		self.story = story
		self.label = label
		self.unique = unique
		self.DesignType = DesignType
		self.DesignSection = DesignSection
		
data = IN[0]
out = []

for d in data[2:]:
	frame = Frame(d[0], d[1], d[2], d[3], d[7])
	out.append(frame)
	
OUT = out
# ----------------------------------------
python_create_structural_framing = Python(IN[0]=python_beam_and_brace_connection, IN[1]=python_joint_coordinates_object, IN[2]=python_frame_assignment_summary)
# ---------- python_create_structural_framing.python (67 lines) ----------
# Enable Python support and load DesignScript library
import sys
import clr
clr.AddReference('ProtoGeometry')
from Autodesk.DesignScript.Geometry import *

clr.AddReference("RevitServices")
import RevitServices
from RevitServices.Persistence import DocumentManager
from RevitServices.Transactions import TransactionManager

clr.AddReference("RevitAPI")
import Autodesk
from Autodesk.Revit.DB import *


def getFamilyType(name, familySymbols):
	for i in familySymbols:
		if Autodesk.Revit.DB.Element.Name.GetValue(i) == name:
			return i
			
def getlevel(name, levels):
	for l in levels:
		if l.Name == name:
			return l

doc = DocumentManager.Instance.CurrentDBDocument

BeamConn = IN[0]
JointConn = IN[1]
Frame = IN[2]

out = []

levels = FilteredElementCollector(doc).OfCategory(BuiltInCategory.OST_Levels).WhereElementIsNotElementType().ToElements()
level_1 = getlevel("LEVEL 01", levels)

familySymbols = FilteredElementCollector(doc).OfCategory(BuiltInCategory.OST_StructuralFraming).OfClass(FamilySymbol).ToElements()
for b in BeamConn:
	beam = [x for x in Frame if x.label == b.beam]
	joint_I = [x for x in JointConn if x.label == b.I_EndJoint]
	joint_J = [x for x in JointConn if x.label == b.J_EndJoint]
	#point_I = Autodesk.DesignScript.Geometry.Point.ByCoordinates(joint_I[0].X, joint_I[0].Y, joint_I[0].Z + 13700)
	#point_J = Autodesk.DesignScript.Geometry.Point.ByCoordinates(joint_J[0].X, joint_J[0].Y, joint_J[0].Z + 13700)
	#line = Autodesk.DesignScript.Geometry.Line.ByStartPointEndPoint(point_I, point_J)	
	
	point_I = XYZ(joint_I[0].X/304.8, joint_I[0].Y/304.8, (joint_I[0].Z + 13700)/304.8)
	point_J = XYZ(joint_J[0].X/304.8, joint_J[0].Y/304.8, (joint_J[0].Z + 13700)/304.8)
	line = Autodesk.Revit.DB.Line.CreateBound(point_I, point_J)
	
	type = getFamilyType(beam[0].DesignSection, familySymbols)	
	
	TransactionManager.Instance.EnsureInTransaction(doc)
	#if type.IsActive == False:
	#	type.Activate()
	#	doc.Regenerate()
	framing = doc.Create.NewFamilyInstance(line, type, level_1, Structure.StructuralType.Beam)
	TransactionManager.Instance.TransactionTaskDone()
	
	TransactionManager.Instance.EnsureInTransaction(doc)
	doc.Regenerate()
	p = framing.LookupParameter('Etabs')
	p.Set(beam[0].label)
	TransactionManager.Instance.TransactionTaskDone()
	out.append(beam[0].label)	
	
OUT = out
# ----------------------------------------
