# Dynamo graph ETABS MODE_UPDATE.dyn (Dynamo 2.0.2.6826)

# group: Excel Etabs
file_path = Filename("..\BIM Sticky\20190410_ETABS Export v1.xlsx")  # graph input
fromPath = FileObject(path=file_path)  # "File.FromPath"

# group: Collect data
code_block = CodeBlock()
# ---------- code_block.designscript (2 lines) ----------
//Worksheet 2
"Beam and Brace Connect";
# ----------------------------------------
importExcel = Data.ImportExcel(file=fromPath, sheetName=code_block)
code_block_2 = CodeBlock()
# ---------- code_block_2.designscript (2 lines) ----------
//Worksheet 2
"Joint Coordinates";
# ----------------------------------------
importExcel_2 = Data.ImportExcel(file=fromPath, sheetName=code_block_2)
code_block_3 = CodeBlock()
# ---------- code_block_3.designscript (2 lines) ----------
//Worksheet 2
"Frame Assignment Summary";
# ----------------------------------------
importExcel_3 = Data.ImportExcel(file=fromPath, sheetName=code_block_3)

# group: Python create framing
python_beam_and_brace_connection = Python(IN[0]=importExcel)  # "Python Beam and Brace Connection Object"
# ---------- python_beam_and_brace_connection.python (20 lines) ----------
# Enable Python support and load DesignScript library
import clr
clr.AddReference('ProtoGeometry')
from Autodesk.DesignScript.Geometry import *

class Beam:
	def __init__(self, beam, I_EndJoint, J_EndJoint, CurveType):
		self.beam = beam
		self.I_EndJoint = I_EndJoint
		self.J_EndJoint = J_EndJoint
		self.CurveType = CurveType
		
data = IN[0]
out = []

for d in data[1:]:
	beam = Beam(d[0], d[1], d[2], d[3])
	out.Add(beam)
	
OUT = out
# ----------------------------------------
python_joint_coordinates_object = Python(IN[0]=importExcel_2)
# ---------- python_joint_coordinates_object.python (23 lines) ----------
# Enable Python support and load DesignScript library
import clr
clr.AddReference('ProtoGeometry')
from Autodesk.DesignScript.Geometry import *

class JointCoord:
	def __init__(self, story, label, unique, X, Y, Z, special):
		self.story = story
		self.label = label
		self.unique = unique
		self.X = X
		self.Y = Y
		self.Z = Z
		self.special = special
		
data = IN[0]
out = []

for d in data[2:]:
	jointCoord = JointCoord(d[0], d[1], d[2], d[3], d[4], d[5], d[6])
	out.append(jointCoord)
	
OUT = out
# ----------------------------------------
python_frame_assignment_summary = Python(IN[0]=importExcel_3)  # "Python Frame Assignment Summary Object"
# ---------- python_frame_assignment_summary.python (21 lines) ----------
# Enable Python support and load DesignScript library
import clr
clr.AddReference('ProtoGeometry')
from Autodesk.DesignScript.Geometry import *

class Frame:
	def __init__(self, story, label, unique, DesignType, DesignSection):
		self.story = story
		self.label = label
		self.unique = unique
		self.DesignType = DesignType
		self.DesignSection = DesignSection
		
data = IN[0]
out = []

for d in data[2:]:
	frame = Frame(d[0], d[1], d[2], d[3], d[7])
	out.append(frame)
	
OUT = out
# ----------------------------------------
python_update_structural_framing = Python(IN[0]=python_beam_and_brace_connection, IN[1]=python_joint_coordinates_object, IN[2]=python_frame_assignment_summary)
# ---------- python_update_structural_framing.python (62 lines) ----------
# Enable Python support and load DesignScript library
import sys
import clr
clr.AddReference('ProtoGeometry')
from Autodesk.DesignScript.Geometry import *

clr.AddReference("RevitServices")
import RevitServices
from RevitServices.Persistence import DocumentManager
from RevitServices.Transactions import TransactionManager

clr.AddReference("RevitAPI")
import Autodesk
from Autodesk.Revit.DB import *


def getFamilyType(name, familySymbols):
	for i in familySymbols:
		if Autodesk.Revit.DB.Element.Name.GetValue(i) == name:
			return i
			
def getlevel(name, levels):
	for l in levels:
		if l.Name == name:
			return l
			
def dictStructuralFraming(structuralFraming):
	dict = {}
	for s in structuralFraming:
		key = s.LookupParameter('Etabs').AsString()
		dict.Add(key, s) 
	return dict

doc = DocumentManager.Instance.CurrentDBDocument

BeamConn = IN[0]
JointConn = IN[1]
Frame = IN[2]

out = []

levels = FilteredElementCollector(doc).OfCategory(BuiltInCategory.OST_Levels).WhereElementIsNotElementType().ToElements()
level_1 = getlevel("LEVEL 01", levels)

structuralFraming = FilteredElementCollector(doc).OfCategory(BuiltInCategory.OST_StructuralFraming).WhereElementIsNotElementType().ToElements()

dictStruc = dictStructuralFraming(structuralFraming)

familySymbols = FilteredElementCollector(doc).OfCategory(BuiltInCategory.OST_StructuralFraming).OfClass(FamilySymbol).ToElements()
for b in BeamConn:
	beam = [x for x in Frame if x.label == b.beam]
	designSection = beam[0].DesignSection
	RevitFraming = dictStruc[beam[0].label]

	if RevitFraming.Name != designSection:
		type = getFamilyType(beam[0].DesignSection, familySymbols)	
		
		TransactionManager.Instance.EnsureInTransaction(doc)
		RevitFraming.Symbol = type
		TransactionManager.Instance.TransactionTaskDone()
	
OUT = out
# ----------------------------------------
