# Dynamo graph STRUCTURAL FRAMING CUT BACK.dyn (Dynamo 2.0.2.6826)

categories = Categories(index=535)  # graph input
all_elements_of_category = ElementsOfCategory(Category=categories)
python_script = Python(IN[0]=all_elements_of_category)
# ---------- python_script.python (21 lines) ----------
import clr
clr.AddReference('RevitAPI')
from Autodesk.Revit.DB import *

clr.AddReference("RevitServices")
import RevitServices
from RevitServices.Persistence import DocumentManager

doc = DocumentManager.Instance.CurrentDBDocument
elements = UnwrapElement(IN[0])

WorksetIDList = list()
WorksetNameList = list()

for e in elements:
	WorksetIDList.append(doc.GetWorksetTable().GetWorkset(e.WorksetId))
		
for ws in WorksetIDList:
	WorksetNameList.append(ws.Name)

OUT = WorksetNameList
# ----------------------------------------
code_block = CodeBlock(name=python_script) { name == "STRUC"; }
filterByBoolMask = List.FilterByBoolMask(list=all_elements_of_category, mask=code_block)
flatten = List.Flatten(list=filterByBoolMask.in)
code_block_2 = CodeBlock { 1; }
boolean = BoolSelector(true)
ꟿ_beams_fixextents = Custom[ꟿ Beams.FixExtents](beams=flatten, margin=code_block_2, refresh=boolean)  # Detects all beams from the input list with broken extents(actual length - cut length < margin) and attemts to correct them.
watch = Watch(ꟿ_beams_fixextents)
