# Dynamo graph WORKSHOP_FRAMING.dyn (Dynamo 2.0.2.6826)

python_create_structural_framing = Python()  # unwired: IN[0]
# ---------- python_create_structural_framing.python (63 lines) ----------
import sys
import clr
clr.AddReference('ProtoGeometry')
from Autodesk.DesignScript.Geometry import *

clr.AddReference('RevitAPI')
import Autodesk
from Autodesk.Revit.DB import *

clr.AddReference('RevitServices')
import RevitServices
from RevitServices.Persistence import DocumentManager
from RevitServices.Transactions import TransactionManager

def getFamilyType(name, familySymbols):
	for i in familySymbols:
		if Element.Name.GetValue(i) == name:
			return i
			
			
def getLevel(name, levels):
	for i in levels:
		if i.Name == name:
			return i
			
doc = DocumentManager.Instance.CurrentDBDocument

levels = FilteredElementCollector(doc).OfCategory(BuiltInCategory.OST_Levels).WhereElementIsNotElementType().ToElements()

level_01 = getLevel('LEVEL 01', levels)

familySymbols = FilteredElementCollector(doc).OfCategory(BuiltInCategory.OST_StructuralFraming).OfClass(FamilySymbol).ToElements()

CSVdata = IN[0]
out = []

for f in CSVdata[1:]:
	sx, sy, sz = float(f.Start_X), float(f.Start_Y), float(f.Start_Z)
	ex, ey, ez = float(f.End_X), float(f.End_Y), float(f.End_Z)
	
	point_s = XYZ(sx,sy,sz)
	point_e = XYZ(ex,ey,ez)
	line = Autodesk.Revit.DB.Line.CreateBound(point_s,point_e)
	
	type = getFamilyType(f.designType, familySymbols)
	
	TransactionManager.Instance.EnsureInTransaction(doc)
	if type.IsActive == False:
		type.Activate()
		doc.Regenerate()
		
	new_framing = doc.Create.NewFamilyInstance(line, type, level_01, Structure.StructuralType.Beam)
	TransactionManager.Instance.TransactionTaskDone()
	
	TransactionManager.Instance.EnsureInTransaction(doc)
	doc.Regenerate()
	p = new_framing.LookupParameter('id')
	p.Set(f.id)
	TransactionManager.Instance.TransactionTaskDone()
	
	out.append(new_framing)

OUT = out
# ----------------------------------------
python_csv_create = Python()
# ---------- python_csv_create.python (35 lines) ----------
# Enable Python support and load DesignScript library
import clr
import System
clr.AddReference('ProtoGeometry')
from Autodesk.DesignScript.Geometry import *

# Object class for CSV file data
class framing:
	def __init__(self, row):
		self.id = row[0]
		self.designType = row[1]
		self.End_X = row[2]
		self.End_Y = row[3]
		self.End_Z = row[4]
		self.Start_X = row[5]
		self.Start_Y = row[6]
		self.Start_Z = row[7]
		
# read file from path
filepath = "E:/SFDUG/PythonWorkshop/CSV_files/framing.csv"
filereader = System.IO.StreamReader(filepath)

out = []

# loop over items in CSV file. 
while filereader.Peek() > -1:
	line = filereader.ReadLine()
	row = line.Split(",")
	frame = framing(row)
	out.append(frame)
	
# close file
filereader.Close()
	
OUT = out
# ----------------------------------------
python_update_structural_framing = Python()  # unwired: IN[0]
# ---------- python_update_structural_framing.python (53 lines) ----------
import sys
import clr
clr.AddReference('ProtoGeometry')
from Autodesk.DesignScript.Geometry import *

clr.AddReference('RevitAPI')
import Autodesk
from Autodesk.Revit.DB import *

clr.AddReference('RevitServices')
import RevitServices
from RevitServices.Persistence import DocumentManager
from RevitServices.Transactions import TransactionManager

def getFamilyType(name, familySymbols):
	for i in familySymbols:
		if Element.Name.GetValue(i) == name:
			return i
			
def getLevel(name, levels):
	for i in levels:
		if i.Name == name:
			return i
			
def dictStrucFraming(elements):
	dict = {}
	for i in elements:
		key = i.LookupParameter("id").AsString()
		dict.Add(key, i)
	return dict
	
doc = DocumentManager.Instance.CurrentDBDocument

CSVdata = IN[0]

levels = FilteredElementCollector(doc).OfCategory(BuiltInCategory.OST_Levels).WhereElementIsNotElementType().ToElements()

familySymbols = FilteredElementCollector(doc).OfCategory(BuiltInCategory.OST_StructuralFraming).OfClass(FamilySymbol).ToElements()

elements = FilteredElementCollector(doc).OfCategory(BuiltInCategory.OST_StructuralFraming).WhereElementIsNotElementType().ToElements()

dictStruc = dictStrucFraming(elements)

for i in CSVdata[1:]:
	designType = i.designType
	element = dictStruc[i.id]
	
	if element.Name != designType:
		type = getFamilyType(designType, familySymbols)
		TransactionManager.Instance.EnsureInTransaction(doc)
		element.Symbol = type
		TransactionManager.Instance.TransactionTaskDone()
		
# ----------------------------------------
python_csv_update = Python()
# ---------- python_csv_update.python (29 lines) ----------
import clr 
import System

class framing:
	def __init__(self, row):
		self.id = row[0]
		self.designType  = row[1]
		self.End_X = row[2]
		self.End_Y = row[3]
		self.End_Z = row[4]
		self.Start_X = row[5]
		self.Start_Y = row[6]
		self.Start_Z = row[7]
		
filepath = "E:/SFDUG/PythonWorkshop/CSV_files/framingUpdate.csv"
fileReader = System.IO.StreamReader(filepath)

out = []

while fileReader.Peek() > -1:
	line = fileReader.ReadLine()
	row = line.Split(",")
	obj = framing(row)
	out.append(obj)
	
fileReader.Close()

OUT = out
	
# ----------------------------------------
python_graphic_override = Python()  # unwired: IN[0]
# ---------- python_graphic_override.python (34 lines) ----------
import sys
import clr
clr.AddReference('ProtoGeometry')
from Autodesk.DesignScript.Geometry import *

clr.AddReference('RevitAPI')
import Autodesk
from Autodesk.Revit.DB import *

clr.AddReference('RevitServices')
import RevitServices
from RevitServices.Persistence import DocumentManager
from RevitServices.Transactions import TransactionManager

def OverrideElement(element, color, fill):
	i = OverrideGraphicSettings()
	i.SetProjectionFillColor(color)
	i.SetProjectionFillPatternId(fill.Id)
	doc.ActiveView.SetElementOverrides(element.Id, i)
	
doc = DocumentManager.Instance.CurrentDBDocument

elements = FilteredElementCollector(doc).OfCategory(BuiltInCategory.OST_StructuralFraming).WhereElementIsNotElementType().ToElements()

red = Autodesk.Revit.DB.Color(255, 0,0)

fill = UnwrapElement(IN[0])

for i in elements:
	if i.Name == 'HSS6X0.125':
		TransactionManager.Instance.EnsureInTransaction(doc)
		OverrideElement(i, red, fill)
		TransactionManager.Instance.TransactionTaskDone()
		
# ----------------------------------------
fill_patterns = FillPatterns(index=1)
python_move_elements = Python()
# ---------- python_move_elements.python (32 lines) ----------
import sys
import clr
clr.AddReference('ProtoGeometry')
from Autodesk.DesignScript.Geometry import *

clr.AddReference('RevitAPI')
import Autodesk
from Autodesk.Revit.DB import *

clr.AddReference('RevitServices')
import RevitServices
from RevitServices.Persistence import DocumentManager
from RevitServices.Transactions import TransactionManager

clr.AddReference('System')
from System.Collections.Generic import *

doc = DocumentManager.Instance.CurrentDBDocument

elements = FilteredElementCollector(doc).OfCategory(BuiltInCategory.OST_StructuralFraming).WhereElementIsNotElementType()

ids = List[ElementId]()

for i in elements:
	ids.Add(i.Id)
	
new_location = XYZ(10, 10, 0)

#TransactionManager.Instance.EnsureInTransaction(doc)
#ElementTransformUtils.MoveElements(doc, ids, new_location)
#TransactionManager.Instance.TransactionTaskDone()
	
# ----------------------------------------
python_create_sheets = Python()  # unwired: IN[0]
# ---------- python_create_sheets.python (28 lines) ----------
import clr
clr.AddReference('ProtoGeometry')
from Autodesk.DesignScript.Geometry import *

clr.AddReference('RevitAPI')
import Autodesk
from Autodesk.Revit.DB import *

clr.AddReference('RevitServices')
import RevitServices
from RevitServices.Persistence import DocumentManager
from RevitServices.Transactions import TransactionManager

doc = DocumentManager.Instance.CurrentDBDocument

sheetNum = ['S1.01', 'S1.02']
sheetName = ['level 01', 'level 02']

titleblock = UnwrapElement(IN[0])

TransactionManager.Instance.EnsureInTransaction(doc)

for i in range(len(sheetNum)):
	newSheet = ViewSheet.Create(doc, titleblock.Id)
	newSheet.SheetNumber = sheetNum[i]
	newSheet.Name = sheetName[i]
	
TransactionManager.Instance.TransactionTaskDone()
# ----------------------------------------
family_types = FamilyTypes(index=15)
python_rotate_elements = Python()
# ---------- python_rotate_elements.python (34 lines) ----------
import sys
import clr
clr.AddReference('ProtoGeometry')
from Autodesk.DesignScript.Geometry import *

clr.AddReference('RevitAPI')
import Autodesk
from Autodesk.Revit.DB import *

clr.AddReference('RevitServices')
import RevitServices
from RevitServices.Persistence import DocumentManager
from RevitServices.Transactions import TransactionManager

clr.AddReference('System')
from System.Collections.Generic import *

doc = DocumentManager.Instance.CurrentDBDocument

elements = FilteredElementCollector(doc).OfCategory(BuiltInCategory.OST_StructuralFraming).WhereElementIsNotElementType()

ids = List[ElementId]()

for i in elements:
	ids.Add(i.Id)

angle = 10
origin = XYZ(0,0,0)
offset = XYZ(0,0,10)
rot_axis = Line.CreateBound(origin, offset)

#TransactionManager.Instance.EnsureInTransaction(doc)
#ElementTransformUtils.RotateElements(doc, ids, rot_axis, angle)
#TransactionManager.Instance.TransactionTaskDone()
# ----------------------------------------
python_apply_view_template = Python()
# ---------- python_apply_view_template.python (37 lines) ----------
import clr
clr.AddReference('ProtoGeometry')
from Autodesk.DesignScript.Geometry import *

clr.AddReference('RevitAPI')
import Autodesk
from Autodesk.Revit.DB import *

clr.AddReference('RevitServices')
import RevitServices
from RevitServices.Persistence import DocumentManager
from RevitServices.Transactions import TransactionManager

def GetViewTemplate():
	views = FilteredElementCollector(doc).OfClass(View)
	viewTemp = []
	for i in views:
		if i.IsTemplate == True:
			viewTemp.append(i)
			
	return viewTemp
	
def GetViews():
	views = FilteredElementCollector(doc).OfClass(View)
	return views
	
doc = DocumentManager.Instance.CurrentDBDocument

viewList = GetViews()

viewTemp = GetViewTemplate()

#for i in viewList:
#	if i.Name == 'Level 1' or i.Name == 'Level 2':
#		TransactionManager.Instance.EnsureInTransaction(doc)
#		i.ViewTemplateId = viewTemp[0].Id
#		TransactionManager.Instance.TransactionTaskDone()
# ----------------------------------------
python_get_linked_document = Python()
# ---------- python_get_linked_document.python (36 lines) ----------
import clr
clr.AddReference('ProtoGeometry')
from Autodesk.DesignScript.Geometry import *

clr.AddReference('RevitAPI')
import Autodesk
from Autodesk.Revit.DB import *

clr.AddReference('RevitServices')
import RevitServices
from RevitServices.Persistence import DocumentManager
from RevitServices.Transactions import TransactionManager

from System.Collections.Generic import List

doc = DocumentManager.Instance.CurrentDBDocument

linkedDoc = FilteredElementCollector(doc).OfClass(RevitLinkInstance)

linkDoc, transform = [], []

for i in linkedDoc:
	linkDoc.append(i.GetLinkDocument())
	transform.append(i.GetTotalTransform())
	
elements = FilteredElementCollector(linkDoc[0]).OfCategory(BuiltInCategory.OST_Grids).WhereElementIsNotElementType().ToElements()

ids = List[ElementId]()

for i in elements:
	ids.Add(i.Id)
	
TransactionManager.Instance.EnsureInTransaction(doc)
copy = ElementTransformUtils.CopyElements(linkDoc[0], ids, doc, transform[0],  None)
TransactionManager.Instance.TransactionTaskDone()
	
# ----------------------------------------
