# Dynamo graph Module2 - Samples.dyn "190511-PCW" (Dynamo 2.0.2.6826)

# group: 01 - Adding Revit Node Lib
n01_adding_revit_node_lib = Python()  # "01 - ADDING REVIT NODE LIB"; unwired: IN[0]
# ---------- n01_adding_revit_node_lib.python (15 lines) ----------
# Enable Python support and load DesignScript library
import clr
clr.AddReference('ProtoGeometry')
from Autodesk.DesignScript.Geometry import *

clr.AddReference('RevitNodes')
import Revit

# The inputs to this node will be stored as a list in the IN variables.
dataEnteringNode = IN

# Place your code below this line

# Assign your output to the OUT variable.
OUT = dir(Revit.Elements)
# ----------------------------------------

# group: 02 - Creating Columns
family_types = FamilyTypes(index=2)
levels = Levels(index=0)
n02_creating_columns = Python(IN[0]=family_types, IN[1]=levels)  # "02 - CREATING COLUMNS"
# ---------- n02_creating_columns.python (22 lines) ----------
# Enable Python support and load DesignScript library
import clr
clr.AddReference('ProtoGeometry')
from Autodesk.DesignScript.Geometry import *

clr.AddReference('RevitNodes')
from Revit.Elements import*

# The inputs to this node will be stored as a list in the IN variables.
family = IN[0]
level = IN[1]
output = []

for x in range(0,100,10):
	point = Point.ByCoordinates(x,0,0)
	columns = FamilyInstance.ByPointAndLevel(family,point,level)
	output.append(columns)

# Place your code below this line

# Assign your output to the OUT variable.
OUT = output
# ----------------------------------------
byPointAndLevel = FamilyInstance.ByPointAndLevel()  # unwired: familyType, point, level

# group: 03 - Revit API
family_types_2 = FamilyTypes(index=1)
python_script = Python(IN[0]=family_types_2)
# ---------- python_script.python (35 lines) ----------
# Enable Python support and load DesignScript library
import clr
clr.AddReference('ProtoGeometry')
from Autodesk.DesignScript.Geometry import *

#import RevitAPI

clr.AddReference('RevitAPI')
from Autodesk.Revit.DB import *

clr.AddReference('RevitServices')
from RevitServices.Persistence import DocumentManager
from RevitServices.Transactions import TransactionManager

# The inputs to this node will be stored as a list in the IN variables.
familytype = UnwrapElement(IN[0])
output = []

# Place your code below this line
#Assign Document
doc = DocumentManager.Instance.CurrentDBDocument

#Start Transaction
TransactionManager.Instance.EnsureInTransaction(doc)


for x in range (0,100,10):
	fam = doc.Create.NewFamilyInstance(XYZ(x,x,0), familytype,Structure.StructuralType.NonStructural)
	output.append(fam)
	
#End Transaction
TransactionManager.Instance.TransactionTaskDone()
	
# Assign your output to the OUT variable.
OUT = output
# ----------------------------------------
family = FamilyType.Family(familyType=family_types_2)
types = Family.Types(family=family)
byFamilyType = FamilyInstance.ByFamilyType(familyType=types)

# group: 04 - Wrapping/ UnWrapping
family_types_3 = FamilyTypes(index=2)
python_script_2 = Python(IN[0]=family_types_3)
# ---------- python_script_2.python (38 lines) ----------
# Enable Python Support and load DesignScript Library
import clr
clr.AddReference('ProtoGeometry')
from Autodesk.DesignScript.Geometry import *

#Import Revit API
clr.AddReference('RevitAPI')
from Autodesk.Revit.DB import *

#Import Manger classes
clr.AddReference('RevitServices')
from RevitServices.Persistence import DocumentManager
from RevitServices.Transactions import TransactionManager

#Import DSType method
clr.AddReference('RevitNodes')
import Revit
clr.ImportExtensions(Revit.Elements)

#Inputs to this Node
fam = UnwrapElement(IN[0])
output = []

#Assign Document
doc = DocumentManager.Instance.CurrentDBDocument

#Start Transaction
TransactionManager.Instance.EnsureInTransaction(doc)

for x in range (0,50,10):
	famarray = doc.Create.NewFamilyInstance(XYZ(x,40,0),fam, Structure.StructuralType.NonStructural)
	wrappedfamarray = famarray.ToDSType(False)
	output.append(wrappedfamarray)
	


#Assign your output to the OUT variable
OUT = output
# ----------------------------------------

# group: 05 - Geometry Conversion
family_types_4 = FamilyTypes(index=2)
python_script_3 = Python(IN[0]=family_types_4)  # frozen
# ---------- python_script_3.python (41 lines) ----------
# Enable Python Support and load DesignScript Library
import clr
clr.AddReference('ProtoGeometry')
from Autodesk.DesignScript.Geometry import *

#Import Revit API
clr.AddReference('RevitAPI')
from Autodesk.Revit.DB import *

#Import Manger classes
clr.AddReference('RevitServices')
from RevitServices.Persistence import DocumentManager
from RevitServices.Transactions import TransactionManager

#Import DSType method
clr.AddReference('RevitNodes')
import Revit
clr.ImportExtensions(Revit.Elements)
clr.ImportExtensions(Revit.GeometryConversion)

#Inputs to this Node
fam = UnwrapElement(IN[0])
output = []

#Assign Document
doc = DocumentManager.Instance.CurrentDBDocument

#Start Transaction
TransactionManager.Instance.EnsureInTransaction(doc)

for x in range (0,50,10):
	famarray = doc.Create.NewFamilyInstance(XYZ(x,x,0),fam, Structure.StructuralType.NonStructural)
	wrappedfamarray = famarray.ToDSType(False)
	
	xyz = XYZ(x,x,0)
	output.append(xyz.ToPoint())
	


#Assign your output to the OUT variable
OUT = output
# ----------------------------------------
